vi "index.gviweb"   [LabVIEW NXG 4.0.0]
panel controls:
  "ON/OFF": bool
  "Direction": bool
  "Frequency Setting(Hz)": f64
  "Username": string
  "Password": string
  "Send": bool
panel indicators:
  "Voltage Output(V)": f64
  "Current Output(A)": f64
  "Frequency Output(Hz)": f64
  "Tab": i32
  "INV SW": bool
  "Active Power": string
  "V_dc (ref)": string
  "V_dc (actual)": string
  "frequency": string
  "Reactive power": string
  "BID_SW": bool
  "V_batt": string
  "I_batt": string
  "SC SW": bool
  "V_SC": string
  "I_SC": string
  "FC SW": bool
  "V_FC": string
  "I_FC": string
  "PV Manual": bool
  "PV MPPT": bool
  "V_pv": string
  "I_pv": string
  "GEN Buck Duty": f64
  "Motor Buck Duty": f64
  "PV_Duty": f64
  "WTE SW": bool
  "GEN BUCK": bool
  "V_gen": string
  "I_gen": string
  "WIND SPEED": f64
  "Numeric_7": f64
  "V_dc(ref)": f64
  "INV Control": bool
  "Battery Control": bool
  "SC Control": bool
  "FC Control": bool
  "PV Manual SW": bool
  "PV MPPT SW": bool
  "WIND Control": bool
  "I_SC_ref (Discharging)": f64
  "Numeric_4": f64
  "I_SC_ref (Charging)": f64
  "Numeric_3": f64
  "I_ref (Discharging)": f64
  "Numeric_2": f64
  "I_ref (Charging)": f64
  "Numeric": f64
  "WIND": f64
  "Numeric_8": f64
  "PV Duty": f64
  "Numeric_6": f64
  "I_FC_ref": f64
  "Numeric_5": f64
  "Username_2": string
  "Password_2": string
  "Checkbox": bool
  "URL Image": string
  "URL Image_2": string
uses:
  NI::HTTP::Open HTTP Handle.gvi
  NI::HTTP::PUT Buffer.gvi
  NI::HTTP::Close HTTP Handle.gvi
  NI::HTTP::GET.gvi
diagram:
  call "Open HTTP Handle.gvi"() -> (client handle out=w1, error out=w2)
  while {
    Wait(time to wait=100)
    w3 = "https://mitshubishi-vfd-w-default-rtdb.asia-southeast1.firebasedatabase.app/data.json"
    case ($Send) {
      frame False, Default {
        w4 = ""
        w5 = ""
      }
      frame True {
        w4 = $Username
        w5 = $Password
      }
    }
    Boolean To 0 Or 1(Boolean=$"ON/OFF") -> (0, 1=w6)
    Number To Fractional String(number=w6, precision (6)=2) -> (F-format string=w7)
    Boolean To 0 Or 1(Boolean=$Direction) -> (0, 1=w8)
    Number To Fractional String(number=w8, precision (6)=2) -> (F-format string=w9)
    Number To Fractional String(number=$"Frequency Setting(Hz)", precision (6)=2) -> (F-format string=w10)
    Build Cluster(w7, w9, w10, w4, w5) -> w11
    Flatten To JSON(anything=w11) -> (JSON string=w12)
    call "PUT Buffer.gvi"(client handle=w1, url=w3, buffer=w12, error in=w2) -> (client handle out=w13, error out=w14)
    stop if FALSE
  }
  call "Close HTTP Handle.gvi"(client handle=w13, error in=w14)
  call "Open HTTP Handle.gvi"() -> (client handle out=w15, error out=w16)
  while {
    Wait(time to wait=100)
    w17 = "https://mitshubishi-vfd-default-rtdb.asia-southeast1.firebasedatabase.app/data.json\n"
    call "GET.gvi"(client handle=w15, url=w17, error in=w16) -> (client handle out=w18, body=w19, error out=w20)
    Search Or Split String(search string/char="a", string=w19) -> (match + rest of string=w21)
    Search Or Split String(search string/char="b", string=w21) -> (match + rest of string=w22, substring before match=w23)
    Match Pattern(regular expression="a\",\"", string=w23) -> (after substring=w24)
    Match Pattern(regular expression="\",\"", string=w24) -> (before substring=w25)
    Floating Point String To Number(string=w25) -> (number=w26)
    $"Voltage Output(V)" <- w26
    Search Or Split String(search string/char="c", string=w22) -> (match + rest of string=w27, substring before match=w28)
    Match Pattern(regular expression="b\",\"", string=w28) -> (after substring=w29)
    Match Pattern(regular expression="\",\"", string=w29) -> (before substring=w30)
    Floating Point String To Number(string=w30) -> (number=w31)
    $"Current Output(A)" <- w31
    Search Or Split String(search string/char="d", string=w27) -> (match + rest of string=w32, substring before match=w33)
    Match Pattern(regular expression="c\",\"", string=w33) -> (after substring=w34)
    Match Pattern(regular expression="\",\"", string=w34) -> (before substring=w35)
    Floating Point String To Number(string=w35) -> (number=w36)
    $"Frequency Output(Hz)" <- w36
    Search Or Split String(search string/char="e", string=w32) -> (substring before match=w37)
    Match Pattern(regular expression="d\",\"", string=w37) -> (after substring=w38)
    Match Pattern(regular expression="\",\"", string=w38) -> (before substring=w39)
    Is Equal(x=w39, y="1.0") -> w40
    Boolean To 0 Or 1(Boolean=w40) -> (0, 1=w41)
    $Tab <- w41
    stop if FALSE
  }
  call "Close HTTP Handle.gvi"(client handle=w18, error in=w20)
